# Grasshopper definition MarshalPy2332GHSetup.gh (Grasshopper 1.0.7)
# plug-ins: GH_CPython

marshalpy2 = MarshalPy2()  # -> out, outFile
# ---------- marshalpy2: Python ----------
import os
import sys
mpPath=os.path.normpath(r"C:\Users\pnourian\Documents\GitHub\Genesis\Marshal_Communicators23&32\MarshalPy")
sys.path.append(mpPath)
import MarshalPython as mp

outFile=mp.Send23(mp.dictest2)
if not inFile==None:
    dict3=mp.Receive32(inFile)
    print(dict3)
# ---------- end marshalpy2 ----------
marshalpy3 = MarshalPy3(input=Button(), inFile=marshalpy2.outFile)  # -> output, outFile; inputs input: list, inFile: list
#   port input: [required] - [type = int] - [default = None] Descripe your input here * bullet point. * bullet point
#   port output: indicate your output description here. refers to a new line.
# ---------- marshalpy3: Python ----------
import os
import sys
mpPath=os.path.normpath(r"C:\Users\pnourian\Documents\GitHub\Genesis\Marshal_Communicators23&32\MarshalPy")
sys.path.append(mpPath)
import MarshalPython as mp

outFile=mp.Send32(mp.dictest3)

if not inFile==None:
    dict2=mp.Receive23(inFile)
    print(dict2)
# ---------- end marshalpy3 ----------
marshalpy2_2 = MarshalPy2(inFile=marshalpy3.outFile)  # -> out, outFile; same code as marshalpy2
